# Grasshopper definition hoisting.gh (Grasshopper 1.0.8)
# plug-ins: Pufferfish

dom = ConstructDomain(DomainStart=Slider(0, range=0..100), DomainEnd=Slider(1, range=0..1))
number_slider = Slider(0.406, range=0..1)
dom_2 = ConstructDomain(DomainStart=Slider(0, range=0..100), DomainEnd=Slider(1, range=0..1))
crv = Curve(<curve referenced from the Rhino model>)
crv_2 = Curve(<curve referenced from the Rhino model>)
range = Range(Domain=dom, Steps=Slider(5, range=0..10))
crv_3 = Curve(<curve referenced from the Rhino model>)
crv_4 = Curve(<curve referenced from the Rhino model>)
range_2 = Range(Domain=dom_2, Steps=Slider(10, range=0..10))
crv_5 = Curve(<curve referenced from the Rhino model>)
crv_6 = Curve(<curve referenced from the Rhino model>)
crv_7 = Curve(<curve referenced from the Rhino model>)
crv_8 = Curve(<curve referenced from the Rhino model>)
tweencrv = TweenCurve(CurveA=crv, CurveB=crv_2, Factor=number_slider, BlendType=0)
tweencrv_2 = TweenCurve(CurveA=crv_3, CurveB=crv_6, Factor=number_slider, BlendType=0)
tweencrv_3 = TweenCurve(CurveA=crv_4, CurveB=crv_5, Factor=number_slider, BlendType=0)
len = Length(Curve=crv)
len_2 = Length(Curve=tweencrv)
twnthrucrvscrv = TweenThroughCurvesAlongCurve(Factor=0.5, Normalized=True, Equalized=False, Refit=0, PointSample=0)
tweencrv_4 = TweenCurve(CurveA=crv_7, CurveB=crv_8, Factor=number_slider, BlendType=0)
len_3 = Length(Curve=crv_4)
len_4 = Length(Curve=tweencrv_3)
division = Division(A=len, B=len_2)
division_2 = Division(A=len_3, B=len_4)
ext = ExtendCurve(Curve=tweencrv, Type=0, Start=Slider(0, range=0..100), End=division)
ext_2 = ExtendCurve(Curve=tweencrv_3, Type=0, Start=Slider(0, range=0..100), End=division_2)
panel = Panel(division)
panel_2 = Panel(division_2)
